# Grasshopper definition cluster_random_plan.gh (Grasshopper 1.0.8)
# plug-ins: Human, LunchBoxML, PlanFinderGH

fsettings = FitSettings(
    WidthInterior=100,
    WidthExterior=200,
    DownScaling=0.98,
    UpScaling=1.05,
    ThresholdScore=0,
    AmountOptions=Slider(20, range=0..100),
    UnitSystem=4)

# ----
# Create Random Plans
number_slider = Slider(2, range=0..5)

dom = ConstructDomain(DomainStart=0, DomainEnd=Slider(10, range=0..100))
rectangle = Rectangle(Plane=PlaneXY(0, 0, 0), XSize=dom, YSize=dom, Radius=0)  # -> Rectangle, Length
crv = Curve(rectangle.Rectangle)

unit_curve = Curve(crv)
area = Area(Geometry=unit_curve)  # -> Area, Centroid
scale_nu = ScaleNU(
    Geometry=unit_curve,
    Plane=area.Centroid,
    ScaleX=Slider(1.02, range=0.5..1.5),
    ScaleY=Slider(1.41, range=0.5..1.5),
    ScaleZ=1)  # -> Geometry, Transform
evaluate_curve = EvaluateCurve(Curve=reparameterize(scale_nu.Geometry), Parameter=Slider(0.35, range=0..1))  # -> Point, Tangent, Angle

plan_fit = PlanFit(
    Boundary=scale_nu.Geometry,
    EntranceS=evaluate_curve.Point,
    Beds=-1,
    Baths=-1,
    Country=26,
    FitSettings=fsettings,
    InHousePlans=False)
deconstruct_plan = DeconstructPlan(Plan=plan_fit)  # -> InteriorWalls, ExteriorWalls, DoorCurves, Glass, WindowFrames, Furniture, Score, InternalRoomCurves, DoorBlockInstances, PointBasedFurnitureBlockInstances
deconstruct_room = DeconstructRoom(Room=deconstruct_plan.InternalRoomCurves)  # -> Boundary, InteriorBoundary, Function, PointBasedFurnitureBlockInstances
script = Script(Blocks=deconstruct_plan.DoorBlockInstances)  # -> out, Points; inputs Blocks: list
# ---------- script: Python ----------
import Rhino
import Rhino.Geometry as rg

doc = Rhino.RhinoDoc.ActiveDoc

Points = []

for _x in Blocks:

    obj = _x.Value if hasattr(_x, "Value") else _x

    if not isinstance(obj, rg.InstanceReferenceGeometry):
        continue

    # Get actual block definition
    definition = doc.InstanceDefinitions.FindId(
        obj.ParentIdefId
    )

    if definition is None:
        continue

    # Only interior doors, excluding entrance doors
    if definition.Name == "PF_Door_2D":

        # Block insertion point in world coordinates
        pt = rg.Point3d.Origin
        pt.Transform(obj.Xform)

        Points.append(pt)

print("TOTAL POINTS:", len(Points))
# ---------- end script ----------
geo = Geometry(simplify(deconstruct_room.InteriorBoundary))
geo_2 = Geometry(simplify(script.Points))
G = Geometry(geo_2)
G_2 = Geometry(geo)
# Create Features
area_2 = Area(Geometry=G_2)  # -> Area, Centroid
# Apply Clustering
data = Data(simplify(G))
data_2 = Data(simplify(G_2))
group = Group(Geometry=data)
group_2 = Group(Geometry=data_2)
ma = MassAddition(Input=area_2.Area)  # -> Result, PartialResults
py3 = Python3Script(x=area_2.Area)  # -> out, res; inputs x: list
# ---------- py3: Python ----------
import statistics

res = statistics.variance(x) / statistics.mean(x)
# ---------- end py3 ----------
integer = Integer(Slider(3, range=0..10))
num = Number(Slider(20, range=0..100))
num_2 = Number(simplify(py3.res))
num_3 = Number(simplify(ma.Result))
multiplication = Multiplication(A=num_2, B=Slider(100, range=0..100))
merge = Merge(Data1=multiplication, Data2=num_3)
data_3 = Data(merge)
data_4 = Data(data_3)
k_means_clustering = KMeansClustering(TrainingInputs=data_4, OfClusters=integer, RandomSeed=5)  # -> Result, Likelihood, Centroids
item = ListItem(List=data_3, Index=0, Wrap=True)
tstat = TreeStatistics(Tree=data_3)  # -> Paths, Length, Count
replace = ReplacePaths(Data=group, Search=tstat.Paths, Replace=k_means_clustering.Result)
replace_2 = ReplacePaths(Data=group_2, Search=tstat.Paths, Replace=k_means_clustering.Result)
data_5 = Data(replace)
data_6 = Data(replace_2)
lng = ListLength(List=data_6)
num_4 = Number(num)
integer_2 = Integer(lng)
num_5 = Number(num_4)
integer_3 = Integer(integer)
series = Series(Start=1, Step=1, Count=integer_2)
series_2 = Series(Start=1, Step=1, Count=integer_3)
point = Point(G)
# Create Graph
curve = Curve(G_2)
multiplication_2 = Multiplication(A=series, B=num_5)
multiplication_3 = Multiplication(A=series_2, B=num_4)
script_2 = Script(room_crvs=curve, room_funcs=deconstruct_room.Function, door_pts=point, include_wall_adj=Toggle(True))  # -> out, G, nodes, edges_line, edges_id; inputs room_crvs: list of Curve, room_funcs: list of String, door_pts: list of Point3d
# ---------- script_2: Python ----------
import Rhino.Geometry as rg

class CompasGraph(object):
    def __init__(self):
        self._nodes = {}
        self._edges = {} # (u, v) -> {'type': 'door'/'wall', 'dist': float, 'line': Line}
    def add_node(self, key, **kwargs):
        self._nodes[key] = kwargs
    def add_edge(self, u, v, **kwargs):
        k = tuple(sorted((u, v)))
        # 如果已存在 door 边，则不被 wall 边覆盖
        if k not in self._edges or kwargs.get('edge_type') == 'door':
            self._edges[k] = kwargs
    def nodes(self):
        return list(self._nodes.keys())
    def edges(self):
        return list(self._edges.keys())
    def node_attribute(self, key, name):
        return self._nodes.get(key, {}).get(name, None)
    def edge_attribute(self, u, v, name):
        k = tuple(sorted((u, v)))
        return self._edges.get(k, {}).get(name, None)
    def degree(self, key):
        return sum(1 for u, v in self._edges if u == key or v == key)
    def __repr__(self):
        d_cnt = sum(1 for k, v in self._edges.items() if v.get('edge_type') == 'door')
        w_cnt = sum(1 for k, v in self._edges.items() if v.get('edge_type') == 'wall')
        return "SpatialGraph(Nodes: {}, DoorEdges: {}, WallEdges: {})".format(len(self._nodes), d_cnt, w_cnt)

tol_val = 1.0
add_walls = include_wall_adj if ('include_wall_adj' in locals() and include_wall_adj is not None) else True
crv_list = list(room_crvs) if ('room_crvs' in locals() and room_crvs) else []
func_list = list(room_funcs) if ('room_funcs' in locals() and room_funcs) else []
door_list = list(door_pts) if ('door_pts' in locals() and door_pts) else []

G = CompasGraph()
nodes = []
edges_line = []
edges_id = []

if crv_list:
    valid_indices = []
    # 1. 创建房间节点（自动过滤 FuseBox 或小于 0.8m² 的设备管井，避免重叠）
    for i, crv in enumerate(crv_list):
        if crv is None: continue
        amp = rg.AreaMassProperties.Compute(crv)
        area = amp.Area if amp else 0.0
        func = str(func_list[i]).strip() if i < len(func_list) else "Room_{}".format(i)
        if area < 0.8 or "fuse" in func.lower():
            continue
        pt = amp.Centroid if amp else crv.GetBoundingBox(True).Center
        nid = len(valid_indices)
        valid_indices.append((nid, crv, func, area, pt))
        G.add_node(key=nid, x=pt.X, y=pt.Y, z=pt.Z, func=func, area=area, centroid=pt, boundary=crv)
        nodes.append(pt)

    # 2. 提取门洞连通边 (edge_type = 'door')
    valid_doors = [p for p in door_list if p is not None and p != rg.Point3d.Unset]
    for d_pt in valid_doors:
        dists = []
        for nid, crv, func, area, pt in valid_indices:
            rc, t = crv.ClosestPoint(d_pt)
            if rc:
                dists.append((d_pt.DistanceTo(crv.PointAt(t)), nid))
        dists.sort(key=lambda x: x[0])
        if len(dists) >= 2 and dists[0][0] <= tol_val and dists[1][0] <= tol_val:
            u, v = sorted((dists[0][1], dists[1][1]))
            pu = G.node_attribute(u, 'centroid')
            pv = G.node_attribute(v, 'centroid')
            walk_dist = pu.DistanceTo(d_pt) + d_pt.DistanceTo(pv)
            G.add_edge(u, v, edge_type='door', dist=walk_dist, door_pt=d_pt)

    # 3. 提取共享墙体邻接边 (edge_type = 'wall'，打破单一走廊星型拓扑)
    if add_walls:
        m = len(valid_indices)
        for idx_a in range(m):
            u, crv_u, _, _, pu = valid_indices[idx_a]
            params = crv_u.DivideByCount(36, True)
            s_pts = [crv_u.PointAt(t) for t in params] if params else []
            for idx_b in range(idx_a + 1, m):
                v, crv_v, _, _, pv = valid_indices[idx_b]
                close_cnt = 0
                for p in s_pts:
                    rc, t = crv_v.ClosestPoint(p)
                    if rc and p.DistanceTo(crv_v.PointAt(t)) <= 0.35:
                        close_cnt += 1
                if close_cnt >= 2:
                    G.add_edge(u, v, edge_type='wall', dist=pu.DistanceTo(pv) * 1.25, door_pt=None)

    # 4. 输出边几何与标识
    for u, v in G.edges():
        pu = G.node_attribute(u, 'centroid')
        pv = G.node_attribute(v, 'centroid')
        fu = G.node_attribute(u, 'func')
        fv = G.node_attribute(v, 'func')
        etype = G.edge_attribute(u, v, 'edge_type')
        edges_line.append(rg.Line(pu, pv))
        edges_id.append("{}-{} ({}-{} [{}])".format(u, v, fu, fv, etype))


import scriptcontext as sc
if len(G.nodes()) > 0:
    sc.sticky["LATEST_SPATIAL_GRAPH"] = G
    sc.sticky.setdefault("RECORDED_GRAPHS", []).append(G)
# ---------- end script_2 ----------
Y = UnitY(Factor=multiplication_3)  # -> graft(UnitVector)
X = UnitX(Factor=multiplication_2)
addition = Addition(A=X, B=Y)
data_7 = Data(script_2.G)
vec = Vector(simplify(addition))
vec_2 = Vector(vec)
move = Move(Geometry=data_6, Motion=vec_2)  # -> Geometry, Transform
move_2 = Move(Geometry=data_5, Motion=vec_2)  # -> Geometry, Transform
data_8 = Data(simplify(graft(move.Geometry)))
data_9 = Data(simplify(graft(move_2.Geometry)))
# Regroup in Model Space
vec_3 = Vector(graft(vec))
data_10 = Data(tstat.Paths)
tstat_2 = TreeStatistics(Tree=data_9)  # -> Paths, Length, Count
replace_3 = ReplacePaths(Data=data_9, Search=tstat_2.Paths, Replace=data_10)
replace_4 = ReplacePaths(Data=data_8, Search=tstat_2.Paths, Replace=data_10)
replace_5 = ReplacePaths(Data=vec_3, Search=tstat_2.Paths, Replace=data_10)

# ----
# Score Flats
panel = Panel("""Bath:3.5
WC:1
FuseBox:0.5
Bed:13
Circulation:12
Living:80
Storage:5""")
script_3 = Script(G=data_7, target_rules=panel, req_links="Bed-Circulation")  # -> out, area_score, conn_score, total_score, details, room_srfs, room_cols; inputs target_rules: list of String, req_links: list of String
# ---------- script_3: Python ----------
import Rhino.Geometry as rg
import System.Drawing as sd

raw_G = G if ('G' in locals() and G is not None) else None
graph_obj = raw_G.Value if hasattr(raw_G, 'Value') else raw_G
rules_list = list(target_rules) if ('target_rules' in locals() and target_rules) else []
links_list = list(req_links) if ('req_links' in locals() and req_links) else []

def lerp_color(t):
    t = max(0.0, min(1.0, float(t)))
    if t < 0.5:
        u = t * 2.0
        return sd.Color.FromArgb(200, int(46+(241-46)*u), int(204+(196-204)*u), int(113+(15-113)*u))
    else:
        u = (t - 0.5) * 2.0
        return sd.Color.FromArgb(200, int(241+(231-241)*u), int(196+(76-196)*u), int(15+(60-15)*u))

area_score = 0.0
conn_score = 0.0
total_score = 0.0
details = []
room_srfs = []
room_cols = []

if graph_obj and hasattr(graph_obj, 'nodes'):

    # 1. 计算面积评分与红绿热力面
    target_dict = {}
    for r in rules_list:
        if r and (":" in str(r) or "->" in str(r)):
            sep = "->" if "->" in str(r) else ":"
            p = str(r).split(sep)
            target_dict.setdefault(p[0].strip(), []).append(float(p[1].strip()))

    for k in target_dict:
        target_dict[k].sort(reverse=True)

    func_groups = {}
    for n in graph_obj.nodes():
        func_groups.setdefault(
            str(graph_obj.node_attribute(n, 'func')), []
        ).append(
            (float(graph_obj.node_attribute(n, 'area')), n)
        )

    node_target = {}
    for f, items in func_groups.items():
        items.sort(key=lambda x: x[0], reverse=True)
        t_vals = list(target_dict.get(f, []))

        for idx_rank, (a_val, nid) in enumerate(items):
            if idx_rank < len(t_vals):
                node_target[nid] = t_vals[idx_rank]
                diff = abs(a_val - t_vals[idx_rank])
                area_score += diff

                details.append(
                    "[Area] {}: {:.1f}m² vs {:.1f}m² (pen: {:.2f})".format(
                        f, a_val, t_vals[idx_rank], diff
                    )
                )

            elif len(t_vals) > 0:
                node_target[nid] = t_vals[-1]

    xform_down = rg.Transform.Translation(0, 0, -0.02)

    for n in graph_obj.nodes():
        crv = graph_obj.node_attribute(n, 'boundary')

        if crv:
            breps = rg.Brep.CreatePlanarBreps(crv, 0.001)

            if breps:
                srf = breps[0]
                srf.Transform(xform_down)
                room_srfs.append(srf)

                if n in node_target and node_target[n] > 0:
                    rel_err = abs(
                        float(graph_obj.node_attribute(n, 'area')) - node_target[n]
                    ) / node_target[n]

                    room_cols.append(
                        lerp_color(min(1.0, rel_err / 0.40))
                    )
                else:
                    room_cols.append(
                        sd.Color.FromArgb(160, 215, 220, 225)
                    )

    # 2. 计算连接与邻接评分
    # '-' 代表必须有门连接
    # '~' 代表只需相邻（有图边即可）

    all_pairs = set()
    door_pairs = set()

    for u, v in graph_obj.edges():

        func_u = str(graph_obj.node_attribute(u, 'func'))
        func_v = str(graph_obj.node_attribute(v, 'func'))

        pair = tuple(sorted([func_u, func_v]))

        # 所有相邻关系
        all_pairs.add(pair)

        # 只有门连接才加入 door_pairs
        edge_type = graph_obj.edge_attribute(u, v, 'edge_type')

        if str(edge_type).strip().lower() == 'door':
            door_pairs.add(pair)

    # 检查用户要求的连接关系
    for lk in links_list:
        if not lk:
            continue

        s_lk = str(lk).strip()

        if "~" in s_lk:
            sep = "~"
        elif "-" in s_lk:
            sep = "-"
        else:
            continue

        parts = [p.strip() for p in s_lk.split(sep)]

        if len(parts) == 2:
            qp = tuple(sorted(parts))

            if sep == "-":
                # 必须有门连接
                is_valid = qp in door_pairs
            else:
                # 只需要相邻
                is_valid = qp in all_pairs

            if is_valid:
                details.append(
                    "[Conn] {}: OK (0)".format(s_lk)
                )
            else:
                conn_score += 25.0
                details.append(
                    "[Conn] {}: MISSING (+25)".format(s_lk)
                )

    total_score = area_score + conn_score
# ---------- end script_3 ----------
custom_preview = CustomPreview(Geometry=script_3.room_srfs, Material=script_3.room_cols)
panel_2 = Panel(script_3.details)
panel_3 = Panel(script_3.total_score)

ungroup = Ungroup(Group=replace_5)  # -> simplify(Geometry)
ungroup_2 = Ungroup(Group=replace_3)  # -> simplify(Geometry)
ungroup_3 = Ungroup(Group=replace_4)  # -> simplify(Geometry)
vec_4 = Vector(simplify(graft(ungroup)))
data_11 = Data(ungroup_2)
data_12 = Data(ungroup_3)
vec_5 = Vector(vec_4)
vec_6 = Vector(vec_4)
data_13 = Data(data_12)
data_14 = Data(data_11)
previewlw = CustomPreviewLineweights(Geometry=data_13, Shader=ColourSwatch(SwatchColor=RGB(0, 0, 0)), Thickness=Slider(3, range=0..10), Absolute=False)

# ----
# Compute Centrality Measures
# A-B: Connected via a door
# A~B: Shared wall
# 0 = Closeness
# 1 = Degree
# 2 = Betweenness
number_slider_2 = Slider(1, range=0..2)
script_4 = Script(G=simplify(data_7), centrality_mode=number_slider_2)  # -> out, graph_srfs, graph_cols, node_pts, node_texts, centrality_report; inputs centrality_mode: Int32
# ---------- script_4: Python ----------
import Rhino.Geometry as rg
import System.Drawing as sd
import math

raw_G = G if ('G' in locals() and G is not None) else None
graph_obj = raw_G.Value if hasattr(raw_G, 'Value') else raw_G
mode = int(centrality_mode) if ('centrality_mode' in locals() and centrality_mode is not None) else 0

def make_solid_ribbon(pt_a, pt_b, half_w=0.045, z_off=0.08):
    """生成实心粗线面片（用于门洞连通边）"""
    v = pt_b - pt_a
    if v.Length < 1e-4: return []
    v.Unitize()
    perp = rg.Vector3d(-v.Y, v.X, 0) * half_w
    poly = rg.Polyline([
        rg.Point3d(pt_a.X+perp.X, pt_a.Y+perp.Y, z_off),
        rg.Point3d(pt_b.X+perp.X, pt_b.Y+perp.Y, z_off),
        rg.Point3d(pt_b.X-perp.X, pt_b.Y-perp.Y, z_off),
        rg.Point3d(pt_a.X-perp.X, pt_a.Y-perp.Y, z_off),
        rg.Point3d(pt_a.X+perp.X, pt_a.Y+perp.Y, z_off)
    ]).ToNurbsCurve()
    b = rg.Brep.CreatePlanarBreps(poly, 0.001)
    return [b[0]] if b else []

def make_dashed_ribbon(pt_a, pt_b, dash_len=0.22, gap_len=0.14, half_w=0.026, z_off=0.08):
    """生成分段虚线面片（用于共墙邻接边）"""
    vec = pt_b - pt_a
    total_len = vec.Length
    if total_len < 1e-4: return []
    vec.Unitize()
    perp = rg.Vector3d(-vec.Y, vec.X, 0) * half_w
    dashes = []
    curr = 0.0
    step = dash_len + gap_len
    while curr < total_len:
        end_d = min(curr + dash_len, total_len)
        if end_d - curr > 0.03:
            p_start = pt_a + vec * curr
            p_end = pt_a + vec * end_d
            poly = rg.Polyline([
                rg.Point3d(p_start.X+perp.X, p_start.Y+perp.Y, z_off),
                rg.Point3d(p_end.X+perp.X, p_end.Y+perp.Y, z_off),
                rg.Point3d(p_end.X-perp.X, p_end.Y-perp.Y, z_off),
                rg.Point3d(p_start.X-perp.X, p_start.Y-perp.Y, z_off),
                rg.Point3d(p_start.X+perp.X, p_start.Y+perp.Y, z_off)
            ]).ToNurbsCurve()
            b = rg.Brep.CreatePlanarBreps(poly, 0.001)
            if b: dashes.append(b[0])
        curr += step
    return dashes

def centrality_red_green(norm_val):
    """越边缘(0.0)越绿 -> 中间(0.5)琥珀黄 -> 越中心(1.0)越红"""
    t = max(0.0, min(1.0, float(norm_val)))
    if t < 0.5:
        u = t * 2.0
        r = int(46 + (241 - 46) * u)
        g = int(204 + (196 - 204) * u)
        b = int(113 + (15 - 113) * u)
    else:
        u = (t - 0.5) * 2.0
        r = int(241 + (231 - 241) * u)
        g = int(196 + (60 - 196) * u)
        b = int(15 + (45 - 15) * u)
    return sd.Color.FromArgb(245, r, g, b)

graph_srfs = []
graph_cols = []
node_pts = []
node_texts = []
centrality_report = []

if graph_obj and hasattr(graph_obj, 'nodes') and len(graph_obj.nodes()) > 0:
    nodes_list = list(graph_obj.nodes())
    n_cnt = len(nodes_list)
    
    # 1. Floyd-Warshall 最短路径与中心性计算
    dist_mat = {u: {v: 999.0 for v in nodes_list} for u in nodes_list}
    next_node = {u: {v: None for v in nodes_list} for u in nodes_list}
    for u in nodes_list: dist_mat[u][u] = 0.0
    for u, v in graph_obj.edges():
        w = float(graph_obj.edge_attribute(u, v, 'dist') or 3.0)
        dist_mat[u][v] = dist_mat[v][u] = w
        next_node[u][v] = v
        next_node[v][u] = u
        
    for k in nodes_list:
        for i in nodes_list:
            for j in nodes_list:
                if dist_mat[i][k] + dist_mat[k][j] < dist_mat[i][j]:
                    dist_mat[i][j] = dist_mat[i][k] + dist_mat[k][j]
                    next_node[i][j] = next_node[i][k]

    deg_c, close_c, bet_c = {}, {}, {u: 0.0 for u in nodes_list}
    for u in nodes_list:
        deg_c[u] = graph_obj.degree(u) / float(max(n_cnt - 1, 1))
        reach = [dist_mat[u][v] for v in nodes_list if v != u and dist_mat[u][v] < 500.0]
        close_c[u] = (len(reach) / sum(reach)) if (reach and sum(reach) > 0) else 0.0

    for s in nodes_list:
        for t in nodes_list:
            if s >= t or next_node[s][t] is None: continue
            curr = next_node[s][t]
            while curr is not None and curr != t:
                bet_c[curr] += 1.0
                curr = next_node[curr][t]
    denom = max(1.0, (n_cnt - 1) * (n_cnt - 2) * 0.5)
    for u in nodes_list: bet_c[u] /= denom

    active_c = close_c if mode == 0 else (deg_c if mode == 1 else bet_c)
    c_min, c_max = min(active_c.values()), max(active_c.values())
    c_span = (c_max - c_min) if (c_max > c_min) else 1.0

    # 统一固定节点半径 (不改变圆的大小)
    FIXED_RAD = 0.42
    OUTER_RAD = FIXED_RAD + 0.05

    # 2. 绘制边（裁剪至圆盘外沿，门连通=粗实线，共墙相连=虚线）
    for u, v in graph_obj.edges():
        pu = graph_obj.node_attribute(u, 'centroid')
        pv = graph_obj.node_attribute(v, 'centroid')
        etype = graph_obj.edge_attribute(u, v, 'edge_type')
        
        vec = pv - pu
        dist = vec.Length
        if dist > OUTER_RAD * 2.05:
            vec.Unitize()
            p_start = pu + vec * OUTER_RAD
            p_end = pv - vec * OUTER_RAD
            if etype == 'door':
                ribs = make_solid_ribbon(p_start, p_end, half_w=0.048, z_off=0.5)
                for r_srf in ribs:
                    graph_srfs.append(r_srf)
                    graph_cols.append(sd.Color.FromArgb(240, 44, 62, 80)) # 深炭灰实线
            else:
                dashes = make_dashed_ribbon(p_start, p_end, dash_len=0.22, gap_len=0.14, half_w=0.028, z_off=0.5)
                for d_srf in dashes:
                    graph_srfs.append(d_srf)
                    graph_cols.append(sd.Color.FromArgb(215, 95, 110, 125)) # 石板灰虚线

    # 3. 绘制等大圆盘（中心红 -> 边缘绿）
    for u in nodes_list:
        pt = graph_obj.node_attribute(u, 'centroid')
        func = str(graph_obj.node_attribute(u, 'func'))
        val = active_c[u]
        norm_v = (val - c_min) / c_span
        
        c_out = rg.Circle(rg.Point3d(pt.X, pt.Y, 0.05), OUTER_RAD).ToNurbsCurve()
        b_out = rg.Brep.CreatePlanarBreps(c_out, 0.001)
        if b_out:
            graph_srfs.append(b_out[0])
            graph_cols.append(sd.Color.FromArgb(250, 255, 255, 255))
            
        c_in = rg.Circle(rg.Point3d(pt.X, pt.Y, 0.06), FIXED_RAD).ToNurbsCurve()
        b_in = rg.Brep.CreatePlanarBreps(c_in, 0.001)
        if b_in:
            graph_srfs.append(b_in[0])
            graph_cols.append(centrality_red_green(norm_v))
            
        node_pts.append(rg.Point3d(pt.X, pt.Y, 0.10))
        node_texts.append("{}\nC={:.2f}".format(func, val))
        centrality_report.append("#{} {}: Closeness={:.3f} | Degree={:.2f} | Betweenness={:.2f}".format(
            u, func, close_c[u], deg_c[u], bet_c[u]
        ))

graph_col = graph_cols
# ---------- end script_4 ----------
panel_4 = Panel(script_4.centrality_report)

move_3 = Move(Geometry=script_4.graph_srfs, Motion=vec_5)  # -> simplify(Geometry), Transform
move_4 = Move(Geometry=script_4.node_pts, Motion=vec_6)  # -> simplify(Geometry), Transform

text_tag_3d = TextTag3D(Location=move_4.Geometry, Text=script_4.node_texts, Size=Slider(0.25, range=0..1), Justification=7)
custom_preview_2 = CustomPreview(Geometry=move_3.Geometry, Material=script_4.graph_cols)
